% Simulink data dictionary position_data.sldd

R = Simulink.Parameter(4)
L = Simulink.Parameter(2.75e-6)
J = Simulink.Parameter(3.2284e-6)
ke = Simulink.Parameter(0.0274)
kt = Simulink.Parameter(0.0274)
b = Simulink.Parameter(3.5077e-6)
kd = Simulink.Parameter(6.98)
ki = Simulink.Parameter(12396450.7067)
kp = Simulink.Parameter(18842.98)